# Grasshopper definition 23_11_07_ Gcode cleaned.gh (Grasshopper 1.0.7)

curve = Curve(<curve referenced from the Rhino model>)

# ---- group: BED
number_slider = Slider(22, range=0..100)
rectangle = Rectangle(Plane=PlaneXY(0, 0, 0), XSize=number_slider, YSize=number_slider, Radius=0)  # -> Rectangle, Length

# ---- group: Value XYZ based on the curve / Curve / Path of the printer
curve_2 = Curve(curve)

# ---- group: Value XYZ based on the curve / Number of pts that will be used to give XYZ value in the Gcode ("resolution of the print")
number_slider_2 = Slider(2000, range=0..10000)

# ---- group: Value XYZ based on the curve
flip = FlipCurve(Curve=curve_2)  # -> Curve, Flag
divide_curve = DivideCurve(Curve=flip.Curve, Count=number_slider_2, Kinks=invert(False))  # -> Points, Tangents, Parameters
interpolate = Interpolate(Vertices=divide_curve.Points, Degree=expr("1", 1), Periodic=False, KnotStyle=1)  # -> Curve, Length, Domain
item = ListItem(List=divide_curve.Points, Index=0, Wrap=True)
explode = Explode(Curve=interpolate.Curve, Recursive=True)  # -> Segments, Vertices
point = Point(flatten(explode.Vertices))
deconstruct = Deconstruct(Point=point)  # -> XComponent, YComponent, ZComponent

# ---- group: Value XYZ based on the curve / Check tarting pt. (if wrong : plug the reverse curve component in curve)
pt = Point(item)

# ---- group: Find the pt where material needs to be changed
number_slider_3 = Slider(1914, range=0..10000)

# ---- group: E component in the Gcode
length = Length(Curve=explode.Segments)
multiplication = Multiplication(A=length, B=Slider(0.1, range=0..1))
ma = MassAddition(Input=multiplication)  # -> Result, PartialResults

# ---- group: End of the print
panel = Panel(""";TIME_ELAPSED:520.418334
G1 F1500 E185.80448
M107
G91 ;Relative positioning
G1 E-2 F2700 ;Retract a bit
G1 E-2 Z0.2 F2400 ;Retract and raise Z
G1 X5 Y5 F3000 ;Wipe out
G1 Z10 ;Raise Z more
G90 ;Absolute positioning

G1 X0 Y220 ;Present print
M106 S0 ;Turn-off fan
M104 S0 ;Turn-off hotend
M140 S0 ;Turn-off bed

M84 X Y E ;Disable all steppers but Z

M82 ;absolute extrusion mode
M104 S0
;End of Gcode""")

# ---- group: path of the printer
concatenate = Concatenate(
    A="G1 F750",
    X=" X",
    Xnum=deconstruct.XComponent,
    Y=" Y",
    Ynum=deconstruct.YComponent,
    Z=" Z",
    Znum=deconstruct.ZComponent,
    E=" E",
    Enum=ma.PartialResults)

# ---- group: Change of material
ins = InsertItems(List=concatenate, Item=flatten("M600 ; execute filament change"), Indices=number_slider_3, Wrap=True)

# ---- group: Temperature of the head
number_slider_4 = Slider(230, range=175..250)

# ---- group: Settings print / Layer height
number_slider_5 = Slider(0.2, range=0..1)

# ---- group: Settings print
panel_2 = Panel(""";FLAVOR:Marlin
;TIME:520
;Filament used: 0.192304m
;Layer height: """)
panel_3 = Panel(""";MINX:105.2
;MINY:105.2
;MINZ:0.2
;MAXX:114.8
;MAXY:114.8
;MAXZ:10
;Generated with Cura_SteamEngine 5.3.1
M82 ;absolute extrusion mode
; Ender 3 Custom Start G-code
G92 E0 ; Reset Extruder
G28 ; Home all axes
M104 S190 ; Start heating up the nozzle most of the way
M190 S50 ; Start heating the bed, wait until target temperature reached
M109 S""")
panel_4 = Panel("""; Finish heating the nozzle
G1 Z2.0 F3000 ; Move Z Axis up little to prevent scratching of Heat Bed
G1 X0.1 Y20 Z0.3 F5000.0 ; Move to start position
G1 X0.1 Y200.0 Z0.3 F1500.0 E15 ; Draw the first line
G1 X0.4 Y200.0 Z0.3 F5000.0 ; Move to side a little
G1 X0.4 Y20 Z0.3 F1500.0 E30 ; Draw the second line
G92 E0 ; Reset Extruder
G1 Z2.0 F3000 ; Move Z Axis up little to prevent scratching of Heat Bed
G1 X5 Y20 Z0.3 F5000.0 ; Move over to prevent blob squish
G92 E0
G92 E0
G1 F1500 E-6.5
;LAYER_COUNT:50
;LAYER:0
M107""")
concat = Concatenate(FragmentA=panel_2, FragmentC=number_slider_5, FragmentB=panel_3, FragmentD=number_slider_4, FragmentE=panel_4)

# ---- group: visualization of this specific point
item_2 = ListItem(List=point, Index=number_slider_3, Wrap=True)
preview = CustomPreview(
    Geometry=item_2,
    Material={diffuse=RGB(221, 160, 221), emission=RGB(66, 48, 66), shine=0.5, specular=RGB(255, 255, 255), transparency=0})

# ----
merge = Merge(Data1=flatten(concat), Data2=flatten(concatenate), Data4=flatten(panel))

# ----
# Copy only data in a Gcode file (.Gcode)
gcode = Panel(merge)
