# Grasshopper definition 23_11_10_ Toolpath.gh (Grasshopper 1.0.8)
# plug-ins: Heteroptera, Pufferfish

# ---- group: Size branche
horizontal = Slider(8, range=0..100)
vertical = Slider(50, range=0..100)

# ---- group: Space between branches
number_slider = Slider(3, range=0..10)

# ---- group: Branches
addition = Addition(A=horizontal, B=number_slider)
X = UnitX(Factor=addition)

# ---- group: Nucleus / Size of the nucleus
number_slider_2 = Slider(4, range=0..100)

# ---- group: Branches / First branches
pt = Point(Point(0, 0, 0))
xy = XYPlane(Origin=pt)
addition_2 = Addition(A=number_slider_2, B=vertical)
rectangle = Rectangle(Plane=xy, XSize=horizontal, YSize=addition_2, Radius=0)  # -> Rectangle, Length

# ---- group: Branches / Secind branche
second_branche = Move(Geometry=rectangle.Rectangle, Motion=X)  # -> Geometry, Transform

# ---- group: Nucleus
edges = BrepEdges(Brep=[rectangle.Rectangle, second_branche.Geometry])  # -> Naked, Interior, NonManifold
item = ListItem(List=edges.Naked, Index=Slider(3, range=0..10), Wrap=True)
midpt = CurveMiddle(Curve=item)  # -> flatten(Midpoint)
item_2 = ListItem(List=midpt, Index=0, Wrap=True)  # -> Item, Item1
ln = Line(StartPoint=item_2.Item, EndPoint=item_2.Item1)
neg = Negative(Value=number_slider_2)

offcrv = OffsetCurve(Curve=ln, Plane=PlaneXY(0, 0, 0), Distance=number_slider_2, BothSides=neg, Kinks=0, CapType=1)

# ---- group: Density pattern LW
number_slider_3 = Slider(0.85, range=0..5)

# ---- group: Branches connections
number_slider_4 = Slider(1.07, range=0..10)

# ---- group: Density pattern passive
number_slider_5 = Slider(1.9, range=0.5..5)

# ---- group: 3areas in branch
srfsplit = SurfaceSplit(Surface=rectangle.Rectangle, Curves=flatten(offcrv))

# ---- group: Passive layer / TPU toolpath layer 1
edges_2 = BrepEdges(Brep=second_branche.Geometry)  # -> Naked, Interior, NonManifold
join = JoinCurves(Curves=edges_2.Naked, Preserve=False)

# ---- group: LW toolpath layer 1 / Isolate one area
area = Area(Geometry=srfsplit)  # -> Area, Centroid
pdecon = Deconstruct(Point=area.Centroid)  # -> XComponent, YComponent, ZComponent
sort = SortList(Keys=pdecon.YComponent, ValuesA=srfsplit)  # -> Keys, ValuesA
rev = ReverseList(List=sort.ValuesA)
item_3 = ListItem(List=rev, Index=0, Wrap=True)  # -> Item, Item1, Item2

# ----
dim = Dimensions(Surface=item_3.Item)  # -> UDimension, VDimension
panel = Panel([dim.UDimension, dim.VDimension])

area_2 = Area(Geometry=join)  # -> Area, Centroid
scale_nu = ScaleNU(Geometry=second_branche.Geometry, Plane=area_2.Centroid, ScaleX=1, ScaleY=number_slider_4, ScaleZ=1)  # -> Geometry, Transform

# ---- group: Passive layer / TPU toolpath layer 1
edges_3 = BrepEdges(Brep=offcrv)  # -> Naked, Interior, NonManifold
join_2 = JoinCurves(Curves=edges_3.Naked, Preserve=False)

# ---- group: Passive layer / TPU toolpath layer 1 / Contour long line
area_3 = Area(Geometry=scale_nu.Geometry)  # -> Area, Centroid
vec = VectorXYZ(XComponent="1", YComponent="0", ZComponent=0)  # -> Vector, Length
contour = Contour(Shape=scale_nu.Geometry, Point=area_3.Centroid, Direction=vec.Vector, Distance=number_slider_5)  # -> flatten(Contours)

area_4 = Area(Geometry=join_2)  # -> Area, Centroid
vec_2 = VectorXYZ(XComponent="1", YComponent="0", ZComponent=0)  # -> Vector, Length
contour_2 = Contour(Shape=join_2, Point=area_4.Centroid, Direction=vec_2.Vector, Distance=number_slider_5)  # -> flatten(Contours)

# ---- group: Matrix
Y = UnitY(Factor=1)
srf = Surface([item_3.Item, item_3.Item2])
edgesdir = EdgesFromDirections(Brep=srf, Directions=Y, Reflex=True, Angle=0)  # -> Edges, Indices, Map
midpt_2 = CurveMiddle(Curve=edgesdir.Edges)
pdecon_2 = Deconstruct(Point=midpt_2)  # -> XComponent, YComponent, ZComponent
sort_2 = SortList(Keys=pdecon_2.XComponent, ValuesA=edgesdir.Edges)  # -> Keys, ValuesA
item_4 = ListItem(List=sort_2.ValuesA, Index=0, Wrap=True)  # -> Item, Item1
X_2 = UnitX(Factor=number_slider)
move = Move(Geometry=item_4.Item1, Motion=X_2)  # -> Geometry, Transform
loft = Loft(
    Curves=[item_4.Item1, move.Geometry],
    Options={Adjust=False, Closed=False, LoftEnds=0, LoftSimp=0, LoftType=0, Rebuild=10, Refit=0.01})

# ---- group: Contour long line
area_5 = Area(Geometry=item_3.Item)  # -> Area, Centroid
vec_3 = VectorXYZ(XComponent="0", YComponent="1", ZComponent=0)  # -> Vector, Length
contour_3 = Contour(Shape=item_3.Item, Point=area_5.Centroid, Direction=vec_3.Vector, Distance=number_slider_3)  # -> flatten(Contours)

# ---- group: Passive layer / TPU toolpath layer 1 / small lines
C = CSharpScript(PT=contour)  # -> out, A, B, C; inputs PT: list of Curve
# ---------- C: C# ----------
    List<Curve> Listpt = new List<Curve>();
    List<Curve> Listpt2 = new List<Curve>();
    List<Curve> Listpt3 = new List<Curve>();

    for (int i = 0; i < PT.Count; i += 2){
      Listpt.Add(PT[i]);
    }

    for (int i = 1; i < PT.Count; i += 2){
      Listpt2.Add(PT[i]);
    }

    for (int i = 2; i < PT.Count; i += 2){
      Listpt3.Add(PT[i]);
    }


    A = Listpt;
    B = Listpt2;
    C = Listpt3;
# ---------- end C ----------
end = EndPoints(Curve=C.B)  # -> Start, End
end_2 = EndPoints(Curve=C.C)  # -> Start, End
end_3 = EndPoints(Curve=C.A)  # -> Start, End

C_2 = CSharpScript(PT=contour_2)  # -> out, A, B, C; inputs PT: list of Curve; same code as C
end_4 = EndPoints(Curve=C_2.B)  # -> Start, End
end_5 = EndPoints(Curve=C_2.C)  # -> Start, End
end_6 = EndPoints(Curve=C_2.A)  # -> Start, End

# ---- group: LW toolpath layer 1 / small lines
C_3 = CSharpScript(PT=contour_3)  # -> out, A, B, C; inputs PT: list of Curve; same code as C
end_7 = EndPoints(Curve=C_3.B)  # -> Start, End
end_8 = EndPoints(Curve=C_3.C)  # -> Start, End
end_9 = EndPoints(Curve=C_3.A)  # -> Start, End

# ---- group: Passive layer / TPU toolpath layer 1 / connection
short = ShortestList(ListA=end_3.Start, ListB=end.Start, TrimMode=2)  # -> ListA, ListB
ln_2 = Line(StartPoint=short.ListA, EndPoint=short.ListB)

# ---- group: Passive layer / TPU toolpath layer 1
short_2 = ShortestList(ListA=end.End, ListB=end_2.End, TrimMode=2)  # -> ListA, ListB
ln_3 = Line(StartPoint=short_2.ListA, EndPoint=short_2.ListB)

# ---- group: Passive layer / connection
short_3 = ShortestList(ListA=end_6.Start, ListB=end_4.Start, TrimMode=2)  # -> ListA, ListB
ln_4 = Line(StartPoint=short_3.ListA, EndPoint=short_3.ListB)

# ---- group: Passive layer
short_4 = ShortestList(ListA=end_4.End, ListB=end_5.End, TrimMode=2)  # -> ListA, ListB
ln_5 = Line(StartPoint=short_4.ListA, EndPoint=short_4.ListB)

# ----
mjoin = MeshJoin(Meshes=[second_branche.Geometry, rectangle.Rectangle])
area_6 = Area(Geometry=mjoin)  # -> Area, Centroid

# ---- group: Passive layer / Perpendicular path tpu / Nucleus perpendicular pattern
edges_4 = BrepEdges(Brep=rectangle.Rectangle)  # -> Naked, Interior, NonManifold
item_5 = ListItem(List=edges_4.Naked, Index=Slider(3, range=0..10), Wrap=True)
midpt_3 = CurveMiddle(Curve=item_5)
yz = YZPlane(Origin=area_6.Centroid)
ln_6 = Line(StartPoint=area_6.Centroid, EndPoint=midpt_3)
mirror = Mirror(Geometry=ln_6, Plane=yz)  # -> Geometry, Transform
join_3 = JoinCurves(Curves=[mirror.Geometry, ln_6], Preserve=False)
offcrv_2 = OffsetCurve(Curve=join_3, Plane=PlaneXY(0, 0, 0), Distance=number_slider_2, BothSides=neg, Kinks=0, CapType=1)

# ---- group: Matrix / Density pattern Matrix
number_slider_6 = Slider(0.36, range=0..5)

# ---- group: LW toolpath layer 1 / connection
short_5 = ShortestList(ListA=end_9.Start, ListB=end_7.Start, TrimMode=2)  # -> ListA, ListB
ln_7 = Line(StartPoint=short_5.ListA, EndPoint=short_5.ListB)

# ---- group: LW toolpath layer 1
short_6 = ShortestList(ListA=end_7.End, ListB=end_8.End, TrimMode=2)  # -> ListA, ListB
ln_8 = Line(StartPoint=short_6.ListA, EndPoint=short_6.ListB)

# ---- group: Passive layer / TPU toolpath layer 1
join_4 = JoinCurves(Curves=flatten([C.A, C.B, ln_3, ln_2]), Preserve=False)
join_5 = JoinCurves(Curves=flatten([C_2.A, C_2.B, ln_5, ln_4]), Preserve=False)

# ---- group: Passive layer
end_10 = EndPoints(Curve=join_5)  # -> Start, End
crv_cp = CurveClosestPoint(Point=end_10.End, Curve=join_4)  # -> Point, Parameter, Distance
ln_9 = Line(StartPoint=crv_cp.Point, EndPoint=end_10.End)
clx = CurveLine(Curve=join_4, Line=ln_9)  # -> Points, Params, Count
shatter = Shatter(Curve=join_4, Parameters=clx.Params)
split = SplitList(List=shatter, Index=1)  # -> ListA, ListB
join_6 = JoinCurves(Curves=flatten([split.ListB, ln_9, join_5]), Preserve=False)

# ---- group: LW toolpath layer 1
join_7 = JoinCurves(Curves=flatten([C_3.A, C_3.B, ln_8, ln_7]), Preserve=False)

# ---- group: LW toolpath layer 1 / second area lw layer 1
Y_2 = UnitY(Factor=1)
edgesdir_2 = EdgesFromDirections(Brep=item_3.Item, Directions=Y_2, Reflex=True, Angle=0)  # -> Edges, Indices, Map
item_6 = ListItem(List=edgesdir_2.Edges, Index=0, Wrap=True)
multiplication = Multiplication(A=number_slider_2, B=2)
len = Length(Curve=item_6)
addition_3 = Addition(A=len, B=multiplication)
Y_3 = UnitY(Factor=addition_3)
rev_2 = Reverse(Vector=Y_3)
move_2 = Move(Geometry=join_7, Motion=rev_2)  # -> Geometry, Transform

# ---- group: Passive layer / Perpendicular path tpu / Density pattern TPU perp. path
# B
# A2
# E
number_slider_7 = Slider(1, range=0..2)

# ---- group: Height layer
number_slider_8 = Slider(0.26, range=0..4)

# ---- group: LW toolpath layer 1 / Single curve
end_11 = EndPoints(Curve=join_7)  # -> Start, End
end_12 = EndPoints(Curve=move_2.Geometry)  # -> Start, End
ln_10 = Line(StartPoint=end_11.Start, EndPoint=end_12.End)
join_8 = JoinCurves(Curves=flatten([join_7, move_2.Geometry, ln_10]), Preserve=False)

# ---- group: Passive layer / Perpendicular path tpu
area_7 = Area(Geometry=offcrv_2)  # -> Area, Centroid
vec_4 = VectorXYZ(XComponent="0", YComponent="1", ZComponent=0)  # -> Vector, Length
contour_4 = Contour(Shape=offcrv_2, Point=area_7.Centroid, Direction=vec_4.Vector, Distance=number_slider_7)  # -> flatten(Contours)

# ----
Z = UnitZ(Factor=number_slider_8)

# ---- group: LW toolpath layer 1 / Single curve / LW layer 2
move_3 = Move(Geometry=join_8, Motion=Z)  # -> Geometry, Transform

# ---- group: LW toolpath layer 1 / Second set of layer
yz_2 = YZPlane(Origin=area_6.Centroid)
mirror_2 = Mirror(Geometry=[move_3.Geometry, join_8], Plane=yz_2)  # -> Geometry, Transform
move_4 = Move(Geometry=mirror_2.Geometry, Motion=Z)  # -> Geometry, Transform

# ---- group: Passive layer
preview = CustomPreview(Geometry=join_6, Material=ColourSwatch(SwatchColor=RGB(10, 79, 23)))

# ---- group: Passive layer / Perpendicular path tpu / small lines
C_4 = CSharpScript(PT=contour_4)  # -> out, A, B, C; inputs PT: list of Curve; same code as C
end_13 = EndPoints(Curve=C_4.B)  # -> Start, End
end_14 = EndPoints(Curve=C_4.C)  # -> Start, End
end_15 = EndPoints(Curve=C_4.A)  # -> Start, End

# ----
panel_2 = Panel(join_8)

# ---- group: LW toolpath layer 1
preview_2 = CustomPreview(Geometry=move_4.Geometry, Material=ColourSwatch(SwatchColor=RGB(132, 138, 21)))

# ---- group: Passive layer / Second set of layer
yz_3 = YZPlane(Origin=area_6.Centroid)
addition_4 = Addition(A=number_slider_8, B=number_slider_8, C=Slider(0.1, range=0..1))
mirror_3 = Mirror(Geometry=join_6, Plane=yz_3)  # -> Geometry, Transform
Z_2 = UnitZ(Factor=addition_4)
move_5 = Move(Geometry=mirror_3.Geometry, Motion=Z_2)  # -> Geometry, Transform

# ---- group: LW toolpath layer 1
preview_3 = CustomPreview(Geometry=join_8, Material=ColourSwatch(SwatchColor=RGB(132, 138, 21)))

# ---- group: Passive layer / Perpendicular path tpu / connection
short_7 = ShortestList(ListA=end_15.Start, ListB=end_13.Start, TrimMode=2)  # -> ListA, ListB
ln_11 = Line(StartPoint=short_7.ListA, EndPoint=short_7.ListB)

# ---- group: Passive layer / Perpendicular path tpu
short_8 = ShortestList(ListA=end_13.End, ListB=end_14.End, TrimMode=2)  # -> ListA, ListB
ln_12 = Line(StartPoint=short_8.ListA, EndPoint=short_8.ListB)

join_9 = JoinCurves(Curves=flatten([C_4.A, C_4.B, ln_12, ln_11]), Preserve=False)
move_6 = Move(Geometry=join_9, Motion=Z)  # -> Geometry, Transform

# ----
relay = Relay([move_3.Geometry, join_8, move_4.Geometry])

# ---- group: Passive layer / Joint all patterns for passive second path
end_16 = EndPoints(Curve=move_5.Geometry)  # -> Start, End
end_17 = EndPoints(Curve=move_6.Geometry)  # -> Start, End
ln_13 = Line(StartPoint=end_16.End, EndPoint=end_17.Start)
join_10 = JoinCurves(Curves=flatten([ln_13, move_5.Geometry, move_6.Geometry]), Preserve=False)

# ---- group: Passive layer
preview_4 = CustomPreview(Geometry=join_10, Material=ColourSwatch(SwatchColor=RGB(10, 79, 23)))

# ----
Y_4 = UnitY(Factor=1)
edgesdir_3 = EdgesFromDirections(Brep=[scale_nu.Geometry, join], Directions=Y_4, Reflex=True, Angle=0)  # -> Edges, Indices, Map
len_2 = Length(Curve=edgesdir_3.Edges)  # -> flatten(Length)
extremums = MinMax(Number=len_2)  # -> Minimum, Maximum
c_script = CSharpScript(Min=extremums.Minimum, Max=extremums.Maximum)  # -> out, A; inputs Min: Double, Max: Double
# ---------- c_script: C# ----------
    A = (Min + ((Max-Min) / 2))/2;
# ---------- end c_script ----------

# ---- group: Num horizontal
number_slider_9 = Slider(4, range=0..10)

# ---- group: Matrix
item_7 = ListItem(List=flatten(loft), Index=0, Wrap=True)

# ---- group: Matrix / Contour long line
area_8 = Area(Geometry=item_7)  # -> Area, Centroid
vec_5 = VectorXYZ(XComponent="1", YComponent="0", ZComponent=0)  # -> Vector, Length
contour_5 = Contour(Shape=item_7, Point=area_8.Centroid, Direction=vec_5.Vector, Distance=number_slider_6)  # -> flatten(Contours)

# ---- group: Matrix / small lines
C_5 = CSharpScript(PT=contour_5)  # -> out, A, B, C; inputs PT: list of Curve; same code as C
end_18 = EndPoints(Curve=C_5.B)  # -> Start, End
end_19 = EndPoints(Curve=C_5.C)  # -> Start, End
end_20 = EndPoints(Curve=C_5.A)  # -> Start, End

# ---- group: Matrix / connection
short_9 = ShortestList(ListA=end_20.Start, ListB=end_18.Start, TrimMode=2)  # -> ListA, ListB
ln_14 = Line(StartPoint=short_9.ListA, EndPoint=short_9.ListB)

# ---- group: Matrix (continued)
short_10 = ShortestList(ListA=end_18.End, ListB=end_19.End, TrimMode=2)  # -> ListA, ListB
ln_15 = Line(StartPoint=short_10.ListA, EndPoint=short_10.ListB)
join_11 = JoinCurves(Curves=[ln_14, contour_5, ln_15], Preserve=False)

preview_5 = CustomPreview(Geometry=join_11, Material=ColourSwatch(SwatchColor=RGB(122, 34, 62)))

# ----
entwine = Entwine(Branch0X=relay, Branch1X=join_6, Branch2X=join_10, Branch3X=join_11, FlattenInputs=False)
bang = ExplodeTree(Data=entwine)  # -> Branch0, Branch1, Branch2, Branch3
passive_2 = Curve(bang.Branch2)

# ---- group: LW
crv = Curve(bang.Branch0)

# ---- group: Passive 1
crv_2 = Curve(bang.Branch1)

# ----
group = Group(Objects=flatten(entwine))
pdecon_3 = Deconstruct(Point=area_6.Centroid)  # -> XComponent, YComponent, ZComponent
c_script_2 = CSharpScript(
    x=pdecon_3.XComponent,
    y=c_script.A,
    BTWbranch=number_slider,
    z=number_slider_9,
    Raw=Slider(2, range=0..10),
    Ratio=number_slider_4)  # -> out, A, B, C, D, E; inputs x: Double, y: Double, BTWbranch: Double, z: Int32, Raw: Int32, Ratio: Double
# ---------- c_script_2: C# ----------
    List<double> translationX = new List<double>();
    List<double> translationXraw2 = new List<double>();
    List<double> translationY = new List<double>();
    List<double> translationR = new List<double>();


    for (int i = 0; i < z; i++){
      double vectorH1 = ((x * 2) + BTWbranch) * i;
      double vectorV1 = (y * 2);

      translationX.Add(vectorH1);
      translationY.Add(vectorV1);
    }
    int zz = z - 1;

    for (int i = 0; i < z - 1; i++){
      double vectorH1 = ((x * 2) + BTWbranch) * i;

      translationXraw2.Add(vectorH1);
    }

    for (int i = 1; i < Raw; i = +2){
      double m = y * 4 * i;

      translationR.Add(m);
    }

    A = translationX;
    B = translationY;
    C = translationR;
    D = x + (BTWbranch / 2);
    E = translationXraw2;
# ---------- end c_script_2 ----------
X_3 = UnitX(Factor=c_script_2.E)
Y_5 = UnitY(Factor=c_script_2.C)
X_4 = UnitX(Factor=c_script_2.A)
X_5 = UnitX(Factor=c_script_2.D)
Y_6 = UnitY(Factor=c_script_2.B)
move_7 = Move(Geometry=group, Motion=Y_6)  # -> Geometry, Transform
move_8 = Move(Geometry=move_7.Geometry, Motion=X_5)  # -> Geometry, Transform
move_9 = Move(Geometry=group, Motion=X_4)  # -> Geometry, Transform
move_10 = Move(Geometry=move_9.Geometry, Motion=Y_5)  # -> Geometry, Transform
move_11 = Move(Geometry=move_8.Geometry, Motion=X_3)  # -> Geometry, Transform

ungroup = Ungroup(Group=[move_10.Geometry, move_9.Geometry, move_11.Geometry])
item_8 = ListItem(List=ungroup, Index=0, Wrap=True)  # -> Item, Item1, Item2, Item3, Item4, Item5, Item6
crv_3 = Curve(item_8.Item6)
crv_4 = Curve(item_8.Item4)
crv_5 = Curve([item_8.Item, item_8.Item1, item_8.Item2, item_8.Item3])
crv_6 = Curve(item_8.Item5)

item_9 = ListItem(List=crv_5, Index=0, Wrap=True)
panel_3 = Panel(item_9)
