# Grasshopper definition GCode extruder and CNC clean.gh (Grasshopper 1.0.8)
# plug-ins: RhinoCodePluginGH

# ---- group: BED printer
division = Division(A=Slider(30, range=0..100), B=Slider(2.54, range=0..10))
rectangle = Rectangle(Plane=PlaneXY(0, 0, 0), XSize=division, YSize=division, Radius=0)  # -> Rectangle, Length

# ---- group: Curve / Path of the printer
curve = Curve(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)

# ----
xy = XYPlane(Origin=Point(0, 0, 0))

# ---- group: Bed CNC
crv = Curve([<curve referenced from the Rhino model> x2])

# ----
flip = FlipCurve(Curve=curve)  # -> Curve, Flag
number_slider = Slider(1.5, range=0..10)
divlength = DivideLength(Curve=curve, Length=number_slider)  # -> Points, Tangents, Parameters
interpolate = Interpolate(Vertices=divlength.Points, Degree=expr("1", 1), Periodic=False, KnotStyle=1)  # -> Curve, Length, Domain
item = ListItem(List=divlength.Points, Index=0, Wrap=True)
explode = Explode(Curve=interpolate.Curve, Recursive=True)  # -> Segments, Vertices

scale = Scale(Geometry=crv, Center=xy, Factor=Slider(25.4, range=0..100))  # -> Geometry, Transform

# ---- group: Curve / Path of the printer
curve_2 = Curve(<curve referenced from the Rhino model>)

# ---- group: Check tarting pt. (if wrong : plug the reverse curve component in curve)
pt = Point(item)

# ----
c_script = CSharpScript(Nozel=Slider(1, range=0..1), Filamentdia="1.75", LayerHeight=Slider(0.3, range=0..1))  # -> out, A; inputs Nozel: Double, Filamentdia: Double, LayerHeight: Double
# ---------- c_script: C# ----------
    //  double nozzleDiameter = Nozel;
    // double filamentDiameter = 1.75;
    // A = Math.Pow(nozzleDiameter / 2, 2) / Math.Pow(filamentDiameter / 2, 2);


    double filamentRadius = Filamentdia / 2; // Filament diameter in mm
    double nozzleDiameter = Nozel;    // Nozzle diameter in mm
    double layerHeight = LayerHeight;       // Layer height in mm


    double Multiplicator = (nozzleDiameter * layerHeight) / (Math.Pow(filamentRadius, 2));

    if ( Multiplicator > Nozel * 0.6){
      A = Nozel * 0.6;
    }

    else {
      A = Multiplicator;
    }
# ---------- end c_script ----------
lng = ListLength(List=explode.Vertices)
dup = DuplicateData(Data=number_slider, Number=lng, Order=True)
multiplication = Multiplication(A=dup, B=c_script.A)
ma = MassAddition(Input=multiplication)  # -> Result, PartialResults

point = Point(flatten(explode.Vertices))
# Extruder
deconstruct = Deconstruct(Point=point)  # -> XComponent, YComponent, ZComponent

# ---- group: path of the printer
concatenate = Concatenate(
    A="G1 F100",
    X=" X",
    Xnum=deconstruct.XComponent,
    Y=" Y",
    Ynum=deconstruct.YComponent,
    Z=" Z",
    Znum=deconstruct.ZComponent,
    E=" E",
    Enum=ma.PartialResults)

# ---- group: End of the print
panel = Panel("""M82 ;absolute extrusion mode
M104 S0
;End of Gcode""")

# ---- group: Settings print
panel_2 = Panel("""M82 ;absolute extrusion mode
G92 E0 ; Reset Extruder
M104 S190 ; Start heating up the nozzle most of the way
M109 S""")

# ---- group: Temperature of the head
number_slider_2 = Slider(230, range=175..250)

# ----
concat = Concatenate(FragmentB=panel_2, FragmentD=number_slider_2)
merge = Merge(Data1=flatten(concat), Data2=flatten(concatenate), Data3=flatten(panel))
gcode = Panel(merge)

# ----
# CNC
number_slider_3 = Slider(1.5, range=0..10)
flip_2 = FlipCurve(Curve=curve_2)  # -> Curve, Flag
divlength_2 = DivideLength(Curve=curve_2, Length=number_slider_3)  # -> Points, Tangents, Parameters
interpolate_2 = Interpolate(Vertices=divlength_2.Points, Degree=expr("1", 1), Periodic=False, KnotStyle=1)  # -> Curve, Length, Domain
item_2 = ListItem(List=divlength_2.Points, Index=0, Wrap=True)
number_slider_4 = Slider(5.005, range=0..10)

# ---- group: Check tarting pt. (if wrong : plug the reverse curve component in curve)
pt_2 = Point(item_2)

# ---- group: cm to Inch for CNC
scale_2 = Scale(Geometry=interpolate_2.Curve, Center=Point(0, 0, 0), Factor="0.03937007874")  # -> Geometry, Transform
explode_2 = Explode(Curve=scale_2.Geometry, Recursive=True)  # -> Segments, Vertices

# ----
point_2 = Point(flatten(explode_2.Vertices))
deconstruct_2 = Deconstruct(Point=point_2)  # -> XComponent, YComponent, ZComponent

cs = CSharpScript(x=deconstruct_2.ZComponent, y=number_slider_4)  # -> out, a; inputs x: Double, y: Double
# ---------- cs: C# ----------
// Grasshopper Script Instance
using System;
using System.Collections;
using System.Collections.Generic;
using System.Drawing;

using Rhino;
using Rhino.Geometry;

using Grasshopper;
using Grasshopper.Kernel;
using Grasshopper.Kernel.Data;
using Grasshopper.Kernel.Types;

public class Script_Instance : GH_ScriptInstance
{
  /* 
    Members:
      RhinoDoc RhinoDocument
      GH_Document GrasshopperDocument
      IGH_Component Component
      int Iteration

    Methods (Virtual & overridable):
      Print(string text)
      Print(string format, params object[] args)
      Reflect(object obj)
      Reflect(object obj, string method_name)
  */
  
  private void RunScript(double x, double y, ref object a)
  {
    
    double Zunit = ((-y)+x);
    a = Zunit;
  }
}
# ---------- end cs ----------
concatenate_2 = Concatenate(A="G1", X=" X", Xnum=deconstruct_2.XComponent, Y=" Y", Ynum=deconstruct_2.YComponent, Z=" Z", Znum=cs.a)

# ---- group: CNC
panel_3 = Panel("""G00 G49 G40.1 G17 G80 G50 G90
G20
(Engraving)
M6 T1
M03 S6250""")
# B
# A2
# E
panel_4 = Panel("M0")
concat_2 = Concatenate(FragmentA="G00 Z-", FragmentB=number_slider_4)
merge_2 = Merge(
    Data1=flatten(panel_3),
    Data2=flatten(concat_2),
    Data3=flatten(concatenate_2),
    Data4=flatten("G00 Z-2.0"),
    Data5=flatten(panel_4))

# ----
# Copy only data in a Gcode file (.Gcode)
panel_5 = Panel(merge_2)
